# Grasshopper definition 20200808_RhinoInsideWorkshop.gh (Grasshopper 1.0.7)
# plug-ins: Rhino.Inside for Autodesk Revit, Pufferfish

# １．Rhino.Inside.Revitの基礎
gallery = ImageGallery(CycleDelay=30, Randomize=False, UseLocalImages=True, UseRemoteImages=True)
panel = Panel("RhinoからRevitの壁を作る")
wall_system_family = WallSystemFamily({"Basic Wall": 0, "Curtain Wall": 1, "Stacked Wall": 2}, selected="Basic Wall")
trigger = Button()
graphical_element = GraphicalElement([<familyinstance referenced from the Revit model> x3])
# 3-3．Make Level in C#
number_slider = Slider(100, range=0..100)
# 1-1．Revitのジオメトリ読み込む
graphical_element_2 = GraphicalElement(<wall referenced from the Revit model>)

# ----
# 2.Rhino.Inside.Revitの基礎GH
# 2-1．複数のレベルをつくる
panel_2 = Panel("設計GL")
number_slider_2 = Slider(10, range=0..100)
number_slider_3 = Slider(4000, range=0..10000)
# 指定のレベルを消す
設計gl = Slider(500, range=0..1000)

# ----
# 2-2．壁を作成
crv = Curve(<curve referenced from the Rhino model>)

# ---- group: How to get type
viewtypes = QueryViewTypes()
value_set_picker = ValueSetPicker(viewtypes)

# ----
# 2-3．マスから壁をつくる
# 全てのレベルを取得する
document_levels = DocumentLevels()

# ----
# 3-2．Transaction
trigger_2 = Button()
trigger_3 = Button()

model = ModelCategoriesPicker({"HVAC ゾーン": -2008107, "MEP 製造用ダクト部品": -2008193, "MEP 製造用ハンガー部品": -2008203, "MEP 製造用収納部品": -2008212, "MEP 製造用配管部品": -2008208, "RVT リンク": -2001352, "エリア": -2003200, "カーテン グリッド": -2000173, "カーテン システム": -2000340, "カーテン パネル": -2000170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}, selected="壁": -2000011)
elementtype_picker = ElementTypePicker(
    model,
    {"カーテンウォール : カーテンウォール": 22905, "カーテンウォール : ショーウィンドウ": 50936, "カーテンウォール : 外部ガラス": 50935, "標準壁 : エクステリア - メタル スタッドのブロック": 75447, "標準壁 : 一般 - 150 mm": 219, "標準壁 : 一般 - 150 mm 組積造": 255, "標準壁 : 一般 - 200 mm": 249, "標準壁 : 一般 - 200 mm - 塗り潰し": 40342, "標準壁 : 一般 - 200 mm CMU": 254, "標準壁 : 一般 - 250 mm": 250, "標準壁 : 一般 - 300 mm": 251, "標準壁 : 一般 - 300 mm 組積造": 253, "標準壁 : 一般 - 375 mm": 252, "標準壁 : 一般 - 90 mm レンガ": 257, "標準壁 : 内壁 - 123 mm 間仕切り(1時間)": 261, "標準壁 : 内壁 - 126 mm 間仕切り(2時間)": 263, "標準壁 : 内壁 - 135 mm 間仕切り(2時間)": 262, "標準壁 : 内壁 - 138 mm 間仕切り(1時間)": 220, "標準壁 : 内壁 - 79 mm 間仕切り(1時間)": 258, "標準壁 : 基礎 - 300 mm コンクリート": 31000, "標準壁 : 外壁 - CMU のレンガ": 264, "標準壁 : 外壁 - メタル スタッドの EIFS": 256, "標準壁 : 外壁 - メタル スタッドのレンガ": 75445, "標準壁 : 外部 - ブロック上のレンガ、メタル スタッドで固定": 221, "標準壁 : 擁壁 - 300 mm コンクリート": 31001}, selected="標準壁 : 一般 - 200 mm")
level = DocumentLevelsPicker({"レベル10": 214910, "レベル9": 214909, "レベル8": 214908, "レベル7": 214907, "レベル6": 214906, "レベル5": 214905, "レベル4": 214904, "レベル3": 214903, "レベル2": 214902, "レベル1": 214901, "設計GL": 214900}, selected="レベル10")
wall = AddWall(Curve=crv, Type=elementtype_picker, Level=level, Height=Slider(2080, range=0..10000))

# ----
# 3.Rhino.Inside.RevitのGH　C＃
# 3-1．C# Hello
number_slider_4 = Slider(500, range=0..1000)
# 平面図をつくる
panel_3 = Panel("Revit側で操作する。現在CreateViewはGHのコンポーネントがない。まだバグがってAPIからつくるとRevitが落ちる")
trigger_4 = Button()

bbox = BoundingBox(Content=graphical_element, Plane=PlaneXY(0, 0, 0), UnionBox=False)  # -> Box, Box_2
X = UnitX(Factor=Slider(813, range=0..1000))
move = Move(Geometry=bbox.Box, Motion=X)  # -> Geometry, Transform

walls = QueryWalls(WallSystemFamily=wall_system_family)
revit_c_script = RevitCSharpScript(Reference=["C:\Program Files\Autodesk\Revit 2020\RevitAPI.dll", "C:\Program Files\Autodesk\Revit 2020\RevitAPIUI.dll", "C:\Users\ykish\AppData\Roaming\Autodesk\Revit\Addins\2020\RhinoInside.Revit\RhinoInside.Revit.dll"])  # -> out, Sphere; inputs elevation: Double, Level: Boolean
# ---------- revit_c_script: C# usings ----------
using RIR = RhinoInside.Revit;
using DB = Autodesk.Revit.DB;
using UI = Autodesk.Revit.UI;
using Rhino.NodeInCode;
# ---------- revit_c_script: C# ----------
    if (RIR.Revit.ActiveUIApplication.Application.VersionNumber == "2020") {
      // create and start the transaction
      var doc = RIR.Revit.ActiveDBDocument;
      var t = new DB.Transaction(doc, "トランザクションの例");
      t.Start();
      try {
        // change Revit document here
        // commit the changes after all changes has been made
        t.Commit();
      }
      catch (Exception txnErr) {
        // if any errors happen while changing the document, an exception is thrown
        // make sure to print the exception message for debugging
        Print(txnErr.Message);
        // and rollback the changes made before error
        t.RollBack();
      }
    } else {
      this.Component.AddRuntimeMessage(GH_RuntimeMessageLevel.Warning, "バージョンが違います。2020しか動きません");
    }
# ---------- end revit_c_script ----------

elemcat = ElementCategory(Element=graphical_element_2)  # -> Element, Category
panel_4 = Panel(elemcat.Category)

geometry = ElementGeometry(Elements=graphical_element_2)
bbox_2 = BoundingBox(Content=geometry, Plane=PlaneXY(0, 0, 0), UnionBox=True)  # -> Box, Box_2
debrep = DeconstructBrep(Brep=bbox_2.Box)  # -> Faces, Edges, Vertices
item = ListItem(List=debrep.Faces, Index=1, Wrap=True)

revit_c_script_2 = RevitCSharpScript(
    elevation=number_slider,
    name="C#からのレベル",
    Triger=trigger_3,
    Reference=["C:\Program Files\Autodesk\Revit 2020\RevitAPI.dll", "C:\Program Files\Autodesk\Revit 2020\RevitAPIUI.dll", "C:\Users\ykish\AppData\Roaming\Autodesk\Revit\Addins\2020\RhinoInside.Revit\RhinoInside.Revit.dll"])  # -> out; inputs elevation: Double, name: String, Triger: Boolean
# ---------- revit_c_script_2: C# ----------
    if (RIR.Revit.ActiveUIApplication.Application.VersionNumber == "2020") {
      if(Triger){

        // create and start the transaction
        var doc = RIR.Revit.ActiveDBDocument;
        var t = new DB.Transaction(doc, "Create Level");
        t.Start();
        try {
          // change Revit document here
          // commit the changes after all changes has been made
          DB.Level level = DB.Level.Create(doc, elevation * 0.00328084);
          level.Name = name;


          t.Commit();
        }
        catch (Exception txnErr) {
          // if any errors happen while changing the document, an exception is thrown
          // make sure to print the exception message for debugging
          Print(txnErr.Message);
          // and rollback the changes made before error
          t.RollBack();
        }
      }
    } else {
      this.Component.AddRuntimeMessage(GH_RuntimeMessageLevel.Warning, "バージョンが違います。2020しか動きません");
    }
# ---------- end revit_c_script_2 ----------

level_2 = LevelsPicker({"レベル10": 214910, "レベル9": 214909, "レベル8": 214908, "レベル7": 214907, "レベル6": 214906, "レベル5": 214905, "レベル4": 214904, "レベル3": 214903, "レベル2": 214902, "レベル1": 214901, "設計GL": 214900}, selected=[])
levels = QueryLevels()
level_3 = Level(levels)
dam = DataDam(DataA=level_3, BufferDelay=10000000, BufferMode=0)
delete = DeleteElement(Elements=dam)

dam_2 = DataDam(DataA=walls, BufferDelay=10000000, BufferMode=0)
panel_6 = Panel("㎜からフィートにする")
revit_c_script_3 = RevitCSharpScript(
    Radius=Slider(500, range=0..1000),
    Trigger=trigger_2,
    Reference=["C:\Program Files\Autodesk\Revit 2020\RevitAPI.dll", "C:\Program Files\Autodesk\Revit 2020\RevitAPIUI.dll", "C:\Users\ykish\AppData\Roaming\Autodesk\Revit\Addins\2020\RhinoInside.Revit\RhinoInside.Revit.dll"])  # -> out, Sphere; inputs Radius: Double, Trigger: Boolean
# ---------- revit_c_script_3: C# usings ----------
using RIR = RhinoInside.Revit;
using DB = Autodesk.Revit.DB;
using UI = Autodesk.Revit.UI;
# ---------- revit_c_script_3: C# ----------
    // make the sphere
    _sphere = new Rhino.Geometry.Sphere(Rhino.Geometry.Point3d.Origin, (double) Radius);
    // if requested, ask Rhino.Inside.Revit to run bake method
    if ((bool) Trigger)
    {
      RIR.Revit.EnqueueAction(CreateGeometry);
    }

    // pass the sphere to output
    Sphere = _sphere;
# ---------- revit_c_script_3: C# additional code ----------
  private Rhino.Geometry.Sphere _sphere;

  private void CreateGeometry(DB.Document doc)
  {
    // convert the sphere into Brep
    var brep = _sphere.ToBrep();
    // let's create a mesh from the Brep
    var meshes = Rhino.Geometry.Mesh.CreateFromBrep(
      brep,
      Rhino.Geometry.MeshingParameters.Default
      );

    // now let's pick the Generic Model category for
    // our baked geometry in Revit
    var revitCategory = new DB.ElementId((int) DB.BuiltInCategory.OST_GenericModel);

    // Finally we can create a DirectShape using Revit API
    // inside the Revit document and add the sphere mesh
    // to the DirectShape
    var ds = DB.DirectShape.CreateElement(doc, revitCategory);
    // we will use Convert.Geometry.GeometryEncoder.ToMesh() method to convert the
    // Rhino mesh to Revit mesh because that is what
    // the AppendShape() method expects

    foreach (var mesh in meshes){
      var geom = RIR.Convert.Geometry.GeometryEncoder.ToMesh(mesh);
      ds.SetShape(new DB.GeometryObject[] { geom });
    }
  }
# ---------- end revit_c_script_3 ----------
revit_c_script_4 = RevitCSharpScript(
    Radius=number_slider_4,
    Trigger=trigger_4,
    Reference=["C:\Program Files\Autodesk\Revit 2020\RevitAPIUI.dll", "C:\Users\ykish\AppData\Roaming\Autodesk\Revit\Addins\2020\RhinoInside.Revit\RhinoInside.Revit.dll", "C:\Program Files\Autodesk\Revit 2020\RevitAPI.dll"])  # -> out, Sphere; inputs Radius: Double, Trigger: Boolean
# ---------- revit_c_script_4: C# ----------
    Sphere = new Rhino.Geometry.Sphere(Rhino.Geometry.Point3d.Origin, (double) Radius);
# ---------- end revit_c_script_4 ----------

# ----
# 高さに応じて並び変え
levels_from_revit = Level(document_levels)
levels_from_revit_2 = Level(levels_from_revit)
getpara = GetElementParameter(Element=levels_from_revit, ParameterKey="高さ")
levels_from_revit_3 = Level(levels_from_revit_2)
sort = SortList(Keys=getpara, ValuesA=levels_from_revit_3)  # -> Keys, ValuesA

panel_7 = Panel(levels_from_revit)
delete_2 = DeleteElement(Elements=dam_2)
panel_8 = Panel(revit_c_script_2)

# ----
# Color Format
# Input
data = Data(1)
# Method
data_2 = Data(1)
# Output
data_3 = Data(1)
# Display
data_4 = Data(1)
# Unuse
data_5 = Data(1)

offcrv = OffsetCurve(Curve=item, Plane=PlaneXY(0, 0, 0), Distance=expr("-x", Slider(805, range=0..1000)), BothSides=False, Kinks=0, CapType=1)

area = Area(Geometry=item)  # -> Area, Centroid
evalsrf = EvaluateSurface(Surface=item, Point=area.Centroid)  # -> Point, Normal, UDirection, VDirection, Frame

levels_from_revit_4 = Level(sort.ValuesA)

pop2d = Populate2D(Region=offcrv, Count=100, Seed=1)

dom = ConstructDomain(DomainStart=Slider(0, range=0..100), DomainEnd=Slider(300, range=0..1000))
lng = ListLength(List=pop2d)
random = Random(Range=dom, Number=lng, Seed=2)
amp = Amplitude(Vector=evalsrf.Normal, Amplitude=random)

xy = XYPlane(Origin=Point(0, 0, 0))
level_elevations_sorted = Number(sort.Keys)
pl_offset = PlaneOffset(BasePlane=xy, Offset=level_elevations_sorted)

len = Length(Curve=item)
division = Division(A=len, B=Slider(2000, range=0..10000))
int = Integer(division)

geometry_2 = ElementGeometry(Elements=wall)
item_2 = ListItem(List=geometry_2, Index=Slider(0, range=0..10), Wrap=True)

# ----
# レベルの情報を用いて階高の算出。階高から壁の高さを指定する
level_elevations_sorted_2 = Number(level_elevations_sorted)
graft = GraftTree(Tree=level_elevations_sorted_2, IncludeEmptyLists=True, IncludeNullItems=True)  # -> simplify(Tree)
shift = ShiftList(List=level_elevations_sorted_2, Shift=1, Wrap=False)  # -> simplify(graft(List))
floor_x = Number(graft)
floor_x_1 = Number(shift)
subtraction = Subtraction(A=floor_x_1, B=floor_x)
shift_2 = ShiftList(List=flatten(subtraction), Shift="-1", Wrap=False)  # -> graft(List)
distances_btwn_levels = Number(shift_2)

panel_9 = Panel(pl_offset)

levels_from_revit_sorted = Level(levels_from_revit_4)
shift_3 = ShiftList(List=flatten(levels_from_revit_sorted), Shift="-1", Wrap=False)  # -> simplify(graft(List))
levels_from_revit_except_final = Level(shift_3)

# ----
# カット用のPlaneをつくる
xy_2 = XYPlane(Origin=Point(0, 0, 0))
level_elevations_sorted_3 = Number(level_elevations_sorted)
pl_offset_2 = PlaneOffset(BasePlane=xy_2, Offset=level_elevations_sorted_3)
shift_4 = ShiftList(List=flatten(pl_offset_2), Shift="-1", Wrap=False)  # -> graft(List)
level_planes_sorted = Plane(shift_4)

pln = Plane(pl_offset)

move_2 = Move(Geometry=pop2d, Motion=amp)  # -> Geometry, Transform
divide = DivideCurve(Curve=item, Count=int, Kinks=False)  # -> Points, Tangents, Parameters
merge = Merge(Data1=flatten(move_2.Geometry), Data2=flatten(divide.Points))

mesh = MeshBrep(
    Brep=move.Geometry,
    Settings={GridMaxCount=0, GridMinCount=16, JaggedSeams=False, MaxEdgeLength=0, MinEdgeLength=0.0001, MinTolerance=0, Refine=True, RefineAngle=0, RelativeTolerance=0.65, SimplePlanes=True, Tolerance=0})
mjoin = MeshJoin(Meshes=mesh)

del = DelaunayMesh(Points=merge, Plane=evalsrf.Frame)

pipeline = GeometryPipeline(
    GroupByLayer=False,
    GroupByType=False,
    IncludeHidden=True,
    IncludeLocked=True,
    LayerFilter="Volume",
    NameFilter="*",
    SublayerFiltering=True,
    TypeFilter=1073741848)
level_planes_sorted_2 = Plane(level_planes_sorted)
brep = Brep(pipeline)
sec = BrepPlane(Brep=flatten(brep), Plane=simplify(graft(level_planes_sorted_2)))  # -> Curves, Points
path_mapper = PathMapper(sec.Curves, source="{A;B}", target="{A}")
perimeter_curves_from_breps_closed = Curve(path_mapper)

panel_10 = Panel(levels_from_revit_except_final)

# ----
# 1-2．ジオメトリをRevit返す
msplit = MeshSplit(Mesh=del, Splitters=mjoin)
item_3 = ListItem(List=msplit, Index=0, Wrap=True)
dam_3 = DataDam(DataA=item_3, BufferDelay=10000000, BufferMode=0)
mshdshape = AddMeshDirectShape(Mesh=dam_3)

panel_11 = Panel(distances_btwn_levels)
preview = CustomPreview(
    Geometry=item_3,
    Material={diffuse=RGB(221, 160, 221), emission=RGB(66, 48, 66), shine=0.5, specular=RGB(255, 255, 255), transparency=0})
panel_12 = Panel(perimeter_curves_from_breps_closed)

perimeter_curves_from_breps = Curve(perimeter_curves_from_breps_closed)
explode = Explode(Curve=perimeter_curves_from_breps, Recursive=True)  # -> Segments, Vertices
trim = TrimTree(Tree=explode.Segments, Depth=1)
atomic_wall_curves = Curve(trim)

# ----
# 3-4．Make Walls in C#
crv_2 = Curve(atomic_wall_curves)
flatten = FlattenTree(Tree=crv_2, Path="{0}")
revit_c_script_5 = RevitCSharpScript(
    line=flatten,
    Triger=trigger,
    Reference=["C:\Program Files\Autodesk\Revit 2020\RevitAPI.dll", "C:\Program Files\Autodesk\Revit 2020\RevitAPIUI.dll", "C:\Users\ykish\AppData\Roaming\Autodesk\Revit\Addins\2020\RhinoInside.Revit\RhinoInside.Revit.dll"])  # -> out; inputs line: Line, Triger: Boolean
# ---------- revit_c_script_5: C# usings ----------
using RIR = RhinoInside.Revit;
using DB = Autodesk.Revit.DB;
using UI = Autodesk.Revit.UI;
using Rhino.NodeInCode;
using System.Linq;
# ---------- revit_c_script_5: C# ----------
    if (RIR.Revit.ActiveUIApplication.Application.VersionNumber == "2020") {
      if(Triger){

        // create and start the transaction
        var doc = RIR.Revit.ActiveDBDocument;
        var t = new DB.Transaction(doc, "Create Level");
        t.Start();
        try {
          // change Revit document here
          // commit the changes after all changes has been made
          double elevation = line.FromZ;
          DB.Level mylevel = FindClosestLevel(elevation);
          DB.Wall myWall = CreateWallUsingCurve1(doc, mylevel, line);
          


          t.Commit();
        }
        catch (Exception txnErr) {
          // if any errors happen while changing the document, an exception is thrown
          // make sure to print the exception message for debugging
          Print(txnErr.Message);
          // and rollback the changes made before error
          t.RollBack();
        }
      }
    } else {
      this.Component.AddRuntimeMessage(GH_RuntimeMessageLevel.Warning, "バージョンが違います。2020しか動きません");
    }
# ---------- revit_c_script_5: C# additional code ----------
  public Dictionary<int, DB.Level> allLevels = new Dictionary<int, DB.Level>();
  public DB.Document activeRevitDoc = null;
  public double feetToMili = 304.8;
  public double miliToFeet = 0.00328084;

  public IOrderedEnumerable<DB.Level> FindAndSortLevels(DB.Document doc)
  {
    return new DB.FilteredElementCollector(doc)
      .WherePasses(new DB.ElementClassFilter(typeof(DB.Level), false))
      .Cast<DB.Level>()
      .OrderBy(e => e.Elevation);
  }

  public DB.Wall CreateWallUsingCurve1(DB.Document document, DB.Level level, Line line)
  {
    // Build a location line for the wall creation

    DB.XYZ start = new DB.XYZ(line.FromX, line.FromY, line.FromZ);
    start = start * miliToFeet;
    DB.XYZ end = new DB.XYZ(line.ToX, line.ToY, line.ToZ);
    end = end * miliToFeet;
    DB.Line geomLine = DB.Line.CreateBound(start, end);

    // Create a wall using the location line
    return DB.Wall.Create(document, geomLine, level.Id, true);
  }

  public DB.Level FindClosestLevel(double inputElevation)
  {
    double tolerance = RhinoDocument.ModelAbsoluteTolerance * 4;
    var minDistance = allLevels.Min(kvp => Math.Abs(inputElevation - kvp.Value.Elevation * feetToMili));
    var closest = allLevels.First(kvp => RhinoMath.EpsilonEquals(Math.Abs(inputElevation - kvp.Value.Elevation * feetToMili), minDistance, tolerance));

    return closest.Value;
  }

  public override void BeforeRunScript()
  {
    allLevels.Clear();
    activeRevitDoc = RIR.Revit.ActiveDBDocument;

    IOrderedEnumerable<DB.Level> levelsBuffer = FindAndSortLevels(activeRevitDoc);

    int i = 0;

    foreach (DB.Level level in levelsBuffer)
    {
      allLevels.Add(i, level);
      i++;
    }


  }
# ---------- end revit_c_script_5 ----------
perimeter_curves_from_breps_2 = Curve(perimeter_curves_from_breps_closed)
distances_btwn_levels_2 = Number(distances_btwn_levels)
levels_from_revit_except_final_2 = Level(levels_from_revit_except_final)

distances_btwn_levels_3 = Number(distances_btwn_levels_2)
atomic_wall_curves_2 = Curve(atomic_wall_curves)
T = Type(<hostobjecttype referenced from the Revit model>)
levels_from_revit_except_final_3 = Level(levels_from_revit_except_final_2)
wall_2 = AddWall(
    Curve=atomic_wall_curves_2,
    Type=T,
    Level=levels_from_revit_except_final_3,
    Height=distances_btwn_levels_3,
    AllowJoins=Toggle(True))  # -> flatten(Wall)
preview_2 = CustomPreview(Geometry=wall_2, Material=ColourSwatch(SwatchColor=RGB(138, 163, 57)))

perimeter_curves_from_breps_3 = Curve(perimeter_curves_from_breps_2)
levels_from_revit_except_final_4 = Level(levels_from_revit_except_final_2)
type = Type(<hostobjecttype referenced from the Revit model>)
floor = AddFloor(Boundary=perimeter_curves_from_breps_3, Type=type, Level=levels_from_revit_except_final_4)  # -> flatten(Floor)
preview_3 = CustomPreview(Geometry=floor, Material=ColourSwatch(SwatchColor=RGB(163, 57, 57)))

dam_4 = DataDam(DataA=wall_2, BufferDelay=10000000, BufferMode=0)
delete_3 = DeleteElement(Elements=dam_4)

series = Series(Start=number_slider_3, Step=number_slider_3, Count=number_slider_2)
neg = Negative(Value=設計gl)
series_2 = Series(Start=1, Step=1, Count=number_slider_2)
concat = Concatenate(FragmentA="レベル", FragmentB=series_2)
merge_2 = Merge(Data1=flatten(neg), Data2=flatten(series))
merge_3 = Merge(Data1=flatten(panel_2), Data2=flatten(concat))
panel_13 = Panel(merge_3)

dam_5 = DataDam(DataA=merge_2, BufferDelay=10000000, BufferMode=0)

level_4 = AddLevel(Elevation=dam_5, Name=merge_3)
